# Grasshopper definition position_trigger.gh (Grasshopper 0.9.76)
# plug-ins: Firefly.Core

# ----
# Note: you can check the Arduino IDE to verify which PORT your board is connected.
# Running the Homing Routine
# 
# MUST BE RUN FIRST EVERYTIME YOU TURN ON THE TRACK CONTROL BOX.
number_slider = Slider(0, range=0..3)
# Connecting to the Arduino's Serial Port
ports_available = COMPortsAvailable()
panel = Panel(ports_available)
item = ListItem(List=panel, Index=number_slider, Wrap=False)

# ----
# Select a desired position for the robot.
# 1.
number_slider_2 = Slider(0, range=0..7)
# Sending Control Positions to the UR Track
# 
# 0 is closest to the HOME end (opposite the MOTOR end)
# 7 is closest to the MOTOR end
# 
# The spacing between positions is approx. 500mm
control_positions = Panel("""0
1
2
3
4
5
6
7""")
item_2 = ListItem(List=control_positions, Index=number_slider_2, Wrap=False)
position = Panel(item_2)

# ----
# Running the Homing Routine
# 
# 1. Check that the Toggle in Step 2 is set to FALSE
# 2. Check that the Toggle in Step 3 is set to FALSE
# 3. Set the Toggle to TRUE
# 4. Once the track is done homing, set the Toggle to FALSE
number_slider_3 = Slider(19200, range=0..100000)
toggle = BooleanToggle(True)
port = Integer(item)
open_port = OpenClosePort(OpenClosePort=toggle, PortNumber=port, BaudRate=number_slider_3)
panel_2 = Panel(open_port)

# ----
# 1.
home_command = Panel("h")
port_2 = Integer(port)
write = SerialWriteGeneric(StartWritingValues=Toggle(False), WriteData=home_command, PortNumber=port_2)  # -> ArduinoOutput, StatusMessage
panel_3 = Panel(write.ArduinoOutput)
panel_4 = Panel(write.StatusMessage)

# ----
# Write the position out to the serial port.
# 
# Note: Toggle should remain TRUE unless you want to send a HOME command (see below).
# 2.
toggle_2 = BooleanToggle(True)
port_3 = Integer(port)
write_2 = SerialWriteGeneric(StartWritingValues=toggle_2, WriteData=position, PortNumber=port_3)  # -> ArduinoOutput, StatusMessage
panel_5 = Panel(write_2.ArduinoOutput)
panel_6 = Panel(write_2.StatusMessage)

# ----
# Once your ready to send the robot, set Toggle to TRUE and the track will start to move.
# 
# IMPORTANT: DO NOT set Toggle to FALSE until the track has finished moving.
# 3.
toggle_3 = BooleanToggle(False)
port_4 = Integer(port)
write_3 = SerialWriteGeneric(StartWritingValues=toggle_3, WriteData="9", PortNumber=port_4)  # -> ArduinoOutput, StatusMessage
panel_7 = Panel(write_3.StatusMessage)
panel_8 = Panel(write_3.ArduinoOutput)

# ---- group: Not really working
# Read incoming messages from the Arduino
read = SerialReadGeneric(StartReadingValues=toggle, PortNumber=port)  # -> SerialOutput, StatusMessage
panel_9 = Panel(read.SerialOutput)
panel_10 = Panel(read.StatusMessage)
